# Grasshopper definition PrefactibilidadEconomica_UsoMixto y estacionamiento- Mexico y Volumetria, usos mixtos, Estacionamiento, Vivienda .gh (Grasshopper 1.0.8)
# Copyright: Samuel Rodriguez y Andres Obregón
# Copyright: Samuel Rodriguez Matus
# Copyright: Samuel Rodriguez
# Copyright: Copyright © [2024] [Andres Obregon Lopez or UDEM]. All rights reserved.
# plug-ins: Bifocals

costo_de_vivienda_por_m2_de_construcción = ValueList({"Interes Social": 9800, "Interés Medio": 14100, "Semi Lujo": 20300, "Lujo": 27900}, selected="Interés Medio")

# ---- group: Curva de Terreno
curve = Curve(<curve referenced from the Rhino model>)

# ----
value_list = ValueList({"Estacionamiento Subterraneo": 0, "Estacionamiento en Niveles": 1}, selected="Estacionamiento Subterraneo")

# ---- group: Cluster
preliminares_de_terreno = InformaciónDeTerreno(curva_de_terreno=curve, parametro_retiros=Slider(0, range=0..3), retiro_via=Slider(1.9, range=0..10))  # -> terreno_2, area_de_retiro_2, curva_de_retiros_2

# ----
en_que_distrito_se_encuentra_el_proyecto = ValueList({"#Distrito Centro# --------------": "#Distrito Centro#", "Distrito Centro": 1, "Distrito Industrial": 1, "Distrito Mitras Centro": 2.3, "Distrito Obispado": 2.3, "#Distrito Poniente# ------------": "#Distrito Poniente#", "Distrito San Jerónimo": 2.3, "Distrito Cumbres": 2.3, "Distrito Cumbres Poniente.": 2.3, "#Distrito Norte# ---------------": "#Distrito Norte#", "Distrito Distrito Cd. Solidaridad": 1.5, "Distrito Mitras Norte": 2, "Distrito San Bernabé": 1.5, "Distrito Valle Verde": 2, "#Distrito Sur# -----------------": "#Distrito Sur#", "Distrito Garza Sada": 2.3, "Distrito Independencia": 2, "Distrito Lázaro Cárdenas": 2.3, "Distrito Satelite": 2.3}, selected="Distrito Industrial")
definir_coeficientes_cos_cas_cus = ValueList({"D1": "0.4""0.1""0.7", "D2": "0.5""0.3""0.7", "D3": "0.6""0.25""1.2", "D4": "0.6""0.2""1.2", "D5": "0.7""0.15"1.4", "D6": "0.7""0.15""1.5", "D7": "0.75""0.13""1.7", "D8": "0.75""0.13""2", "D9": "0.75""0.13""2.5", "D10": "0.75""0.15""3", "D11": "0.75""0.15""5", "D12": "0.8""0.1""100"}, selected="D8")
quieres_generar_el_reporte_excel = BooleanToggle(True)
tipo_de_estacionamiento = ValueList({"Estacionamiento Subterraneo": 8000, "Estacionamiento en Niveles": 5500}, selected="Estacionamiento Subterraneo")
altura_máxima_por_delegación = ValueList({"# Delegación Centro#-------------": "#Delegación Centro#", "Distrito Centro": 2, "Distrito Industrial": 3, "Distrito Mitras Centro": 3, "Distrito Obispado": 3, "# Delegación Poniente#-----------": "#Delegación Poniente#", "Distrito San Jerónimo": 3, "Distrito Cumbres": 3, "Distrito Cumbres Poniente": 2, "# Delegación Norte#--------------": "#Delegación Norte#", "Distrito Distrito Cd. Solidaridad": 3, "Distrito Mitras Norte": 2, "Distrito San Bernabé": 2, "Distrito Valle Verde": 2, "# Delegación Sur#----------------": "#Delegación Sur#", "Distrito Garza Sada": 4, "Distrito Independencia": 2, "Distrito Lázaro Cárdenas": 3, "Distrito Satelite": 2}, selected="Distrito Mitras Centro")
porcentaje_de_circulcion = ValueList({"Vivienda Tipo Interes Social": 0.12, "Vivienda Tipo Interes Medio": 0.18, "Vivienda Tipo Semi Lujo.": 0.22, "Vivienda Tipo Lujo": 0.28}, selected="Vivienda Tipo Interes Medio")
el_proyecto_tendrá_estacionamiento = BooleanToggle(True)
el_proyecto_requerira_demolicion = BooleanToggle(True)
quieres_correr_la_simulación = BooleanToggle(True)
el_proyecto_tendrá_comercio = BooleanToggle(True)
número_de_locales = Slider(10, range=0..10)

# ---- group: Costo Por M2 de Construccion
costo_x_m2_construccion = CostoPorM2DeConstruccion(tipo_de_vivienda=costo_de_vivienda_por_m2_de_construcción)

# ----
en_que_delegación = ValueList({"Delegación Centro": "centro", "Delegación Poniente": "poniente", "Delegación Norte": "norte", "Delegación Sur": "sur"}, selected="Delegación Centro")
no_de_viviendas = Slider(5, range=0..100)
curva_de_retiros = Curve(preliminares_de_terreno.curva_de_retiros_2)

# ---- group: Definición Tipo de Estacionamiento
estacionamiento = DefiniciónTipoDeEstacionamiento(tipo_de_estacionamiento=value_list)

# ----
altura_de_entrepiso = Slider(3, range=3..4)
altura_entrepisos_estacionamiento = Slider(3, range=3..4.5)
altura_entrepisos_vivienda = Slider(3, range=3..4.5)
altura_de_de_usos_mixtos = Slider(3, range=0..5)
costo_de_terreno_por_m2 = Panel("8000")
cos_cus_cas = COEFICIENTESCOSCUSCAS(normativa=definir_coeficientes_cos_cas_cus)  # -> cos_2, cas_2, cus_2
cas = Panel(cos_cus_cas.cas_2)
costo_de_venta_por_m2 = Panel("25000")
circulacion = Panel(porcentaje_de_circulcion)
dirección_dondese_guardara_el_reporte_ex = Panel("D:\Tesis_MAA\Reportes")  # "Dirección dondese guardara el Reporte Excel"
cus = Panel(cos_cus_cas.cus_2)
iva = Panel(".16")
área_de_retiro = Panel(preliminares_de_terreno.area_de_retiro_2)
panel = Panel(cos_cus_cas.cas_2)
costo_por_m2_de_construcción = Panel(costo_x_m2_construccion)
cos = Panel(cos_cus_cas.cos_2)
cosro_de_local_por_m2 = Panel("15000")
área_de_demolición = Panel("150")
utilidad_deseada = Panel("15")
crv_terreno = Data(preliminares_de_terreno.terreno_2)
panel_2 = Panel(cos_cus_cas.cos_2)
panel_3 = Panel(cos_cus_cas.cus_2)
number = Number(circulacion)
prefactibilidad_economica_mty_2025 = Python3Script(
    area_terreno=preliminares_de_terreno.terreno_2,
    valor_terreno=costo_de_terreno_por_m2,
    area_retiros=área_de_retiro,
    curva_retiros=curva_de_retiros,
    COS=panel_2,
    CAS=panel,
    CUS=panel_3,
    Altura_Entrepisos=altura_de_entrepiso,
    H_Max=altura_máxima_por_delegación,
    areaCirculacionPorcentaje=number,
    costoMetroConstruccion=costo_por_m2_de_construcción,
    Costo_de_venta_m2=costo_de_venta_por_m2,
    correrSimulacion=quieres_correr_la_simulación,
    utilidadDeseada=utilidad_deseada,
    IVA=iva,
    demolicion=el_proyecto_requerira_demolicion,
    area_demolicion=área_de_demolición,
    usos_mixtos=el_proyecto_tendrá_comercio,
    num_locales=número_de_locales,
    costo_local_m2=cosro_de_local_por_m2,
    estacionamiento=el_proyecto_tendrá_estacionamiento,
    tipo_estacionamiento=tipo_de_estacionamiento,
    delegacion=en_que_delegación,
    n_viviendas=no_de_viviendas,
    Distrito=en_que_distrito_se_encuentra_el_proyecto,
    Reporte_excel=quieres_generar_el_reporte_excel,
    ruta_carpeta=dirección_dondese_guardara_el_reporte_ex)  # -> out, Area_de_terreno, Valor_del_terreno, Costo_de_demolicion, area_neta, COS_m2, CAS_m2, CUS_m2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; inputs area_terreno: Surface, valor_terreno: Double, area_retiros: Double, curva_retiros: Curve, COS: Double, CAS: Double, CUS: Double, Altura_Entrepisos: Double, H_Max: Double, costoMetroConstruccion: Double, Costo_de_venta_m2: Double, correrSimulacion: Boolean, utilidadDeseada: Double, IVA: Double, demolicion: Boolean, area_demolicion: Int32, usos_mixtos: Boolean, num_locales: Int32, costo_local_m2: Double, estacionamiento: Boolean, tipo_estacionamiento: list of Double, delegacion: list of String, n_viviendas: Int32, Distrito: list of Double, Reporte_excel: Boolean, ruta_carpeta: String
# ---------- prefactibilidad_economica_mty_2025: Python ----------
import Rhino.Geometry as rg 
import math
import scriptcontext as sc  
#---------------------------------------------

# 1) Validar entradas
if area_terreno is None:
    raise ValueError("Conecta una superficie válida al input 'area_terreno'")
if valor_terreno is None:
    raise ValueError("Conecta un valor numérico al input 'valor_terreno'")
if curva_retiros is None:
    raise ValueError("Conecta una curva o superficie válida al input 'curva_retiros'")


# ÁREA DEL TERRENO --------------------
props = rg.AreaMassProperties.Compute(area_terreno)
if props is None:
    raise ValueError("No se pudieron calcular las propiedades de área")
area_value = props.Area

Area_de_terreno = "{:.2f} m2".format(area_value)
print(f"Area_terreno = {area_value} m2")

# VALOR DEL TERRENO ----------------------
total_value = area_value * valor_terreno
Valor_del_terreno = "${:.2f} mxn".format(total_value)
print(f"Valor del Terreno = {total_value:.2f} mxn")

# ÁREA NETA ------------------------------

area_neta = area_value - area_retiros
print(f"Área Util = {area_neta:.2f} m2")


# DEMILICIÓN ? INICIO---------------------------------- # Primer Diferenciador

# costo demolición+licencia+residuo —

if demolicion:
    costo_demolicion = area_demolicion * 1600      # Costo de demolición promedio
    costo_licencia  = area_value * 15              # Costo de licencia de demolicion en Mty
    costo_residuo   = area_value * 0.15            # 15% de área Costo Promedio por el Flette
    total_dem = costo_demolicion + costo_licencia + costo_residuo
    Costo_de_demolicion = "${:.2f} mxn".format(total_dem)
else:
    total_dem = 0.0
    Costo_de_demolicion = "$0.00 mxn"

# DEMILICIÓN ? FIN ----------------------------------

# DEFINIR NORMATIVA. 

# DEFINIR COS —---------------------------------

# 1) Área objetivo según COS

cos_area = area_value * COS

# 2) Texto  para output
COS_m2 = "{:.2f} m2 COS".format(cos_area)

print ("{:.2f} m2 COS".format(cos_area))

# —DEFINIR CAS —---------------------------------

# 1) Área objetivo según CAS o CVA

cas_area = area_value * CAS

# 2) Texto  para output
CAS_m2 = "{:.2f} m2 CAS".format(cas_area)
print("{:.2f} m2 CAS".format(cas_area))

# DEFINIR CUS —---------------------------------

# 1) Área objetivo según CUS

cus_area = area_value * CUS

# 2) Texto  para output
CUS_m2 = "{:.2f} m2 CUS".format(cus_area)
print ("{:.2f} m2 CUS".format(cus_area))

# DEFINIR NIVELES ---------------------------------

Num_Niveles = Altura_Entrepisos * H_Max
print ("{:.2f} mts".format(Num_Niveles))


# FIN DE NORMATIVA

#Defininir el Cus disponible para venta 



# Usos Mixtos? INICIO ---------------- SEGUNDO APORTE

if usos_mixtos:
    if num_locales <= 0:
        raise ValueError("num_locales debe ser al menos 1")


    # 1) Área de cada local
    area_local = cos_area / float(num_locales) # Divide el CUS / el No de locales a construir
    
    # 2) Precio de venta por local
    venta_local = area_local * costo_local_m2

    # 3) WHILE · acumular ingreso total
    iter_locales      = 0
    ingreso_local_tot = 0.0
    max_iter_locales  = 100_000

    while iter_locales < num_locales and iter_locales < max_iter_locales:
        ingreso_local_tot += venta_local
        iter_locales += 1

    if iter_locales >= max_iter_locales:
        raise RuntimeError("Demasiados locales; revisa 'num_locales'")


    area_comercio = cos_area                         # iguala CUS al área comercial
else:
    area_local        = 0.0
    venta_local       = 0.0
    ingreso_local_tot = 0.0
    iter_locales      = 0
    area_comercio     = 0.0      


print (f"Número de Locales :{num_locales:.2f}")
print (f"Area de local :{area_local:.2f}m2")
print (f"Costo de venta de local: ${venta_local:.2f}m2")
print (f"ingreso de locales : ${ingreso_local_tot:.2f}.mxn")
print (f"total de iteraciones:{iter_locales:.2f}")


Area_de_local = "{:.2f} m2 local".format(area_local)
Venta_de_local = "${:.2f} mxn por local".format(venta_local)
Ingreso_de_locales = "${:.2f} mxn total por locales".format(ingreso_local_tot)

# Usos Mixtos? FINAL  ---------------- Tercer diferenciador
# ---------------- ÁREA DE CIRCULACIÓN (antes de estacionamiento) --

area_circulacion = cus_area * areaCirculacionPorcentaje
print(f"Área circulación ({areaCirculacionPorcentaje}%): {area_circulacion:.2f} m2")


# ---------------------------------------------
# BLOQUE  ESTACIONAMIENTO  
# ------------------------------------------------------------------
FACTORES = {
    'centro'  : {'comercial': 35},
    'poniente': {'comercial': 25},
    'norte'   : {'comercial': 30},
    'sur'     : {'comercial': 25}
}
M2_CAJON    = 2.5 * 5
FACTOR_VIAL = 1.50       # Valor de Circulación del 50%  

# --------- LISTAS DE SALIDA DE ESTACIONAMIENTO 
cajones_vivienda  = []
cajones_comercio  = []
cajones_total     = []
area_m2           = []
costo_estac_total = []

# --------- acumulador interno ------------------------------------
_costo_estac_num = []   # solo para sumar internamente

def _as_float(v):
    if isinstance(v, (list, tuple)):
        v = v[0]
    return float(v)

costo_unitario = _as_float(tipo_estacionamiento)

if estacionamiento:
    delegaciones = [d.strip().lower() for d in delegacion]
    if len(delegaciones) != len(Distrito):
        raise ValueError("delegacion y Distrito deben tener la misma longitud.")
    for dep, fac in zip(delegaciones, Distrito):
        regs = FACTORES.get(dep)
        if not regs:
            raise ValueError(f"Delegación '{dep}' no válida. Elige: {', '.join(FACTORES.keys())}")
        cv    = n_viviendas * fac
        cc    = (cos_area - area_circulacion) / regs['comercial'] if cos_area else 0
        total = math.ceil(cv + cc)
        am2   = total * M2_CAJON * FACTOR_VIAL
        costo = am2 * costo_unitario

        cajones_vivienda.append(round(cv, 2))
        cajones_comercio.append(round(cc, 2))
        cajones_total.append(total)
        area_m2.append(int(round(am2, 2)))
        costo_estac_total.append("$ {:,}.mxn".format(int(round(costo))))
        _costo_estac_num.append(costo)
else:
    _costo_estac_num = [0.0]



# ---------------------------------------------
# Factibilidad Económica
# ---------------------------------------------
# Área de circulación


# Costos y precios 

print(f"Venta m² construcción: ${Costo_de_venta_m2:.2f}")
print(f"Costo m² construcción: ${costoMetroConstruccion:.2f}")
Costo_de_venta_minima = (f"Venta minima de m²: ${Costo_de_venta_m2:.2f}.mxn") # factor de cosoto minimo de venta por m2 de construccion
Costo_por_m2_construccion = (f"Costo m² construcción: ${costoMetroConstruccion:.2f}.mxn")

# Costo total de construcción
costos_directos = cus_area  * costoMetroConstruccion + total_dem + cus_area * costoMetroConstruccion
print(f"Costos Directos: ${costos_directos:.2f}")
Costos_Directos = (f"Costos Directos: ${costos_directos:.2f}.mxn")

# Área de venta y precio total de venta
area_com_est =  area_comercio + am2 
area_venta =   cus_area -  area_com_est  # Area de lo que se puede vender

precio_venta_total = ((area_venta * Costo_de_venta_m2) + ingreso_local_tot ) / cus_area # se suma el ingreso total de locales.
precio_venta_vivienda = ( area_venta * Costo_de_venta_m2 ) / cus_area
print(f"Área de venta: {area_venta:.2f} m2")
print(f"Precio venta total: ${precio_venta_total:.2f}.mxn x m2")
print (f"Precio de venta de vivienda : ${precio_venta_vivienda:.2f}.mxn x m2")
Area_de_Venta =  area_venta  # Area de lo que se puede vender
Costo_de_Venta_total = (f"Precio venta total: ${precio_venta_total:.2f}.mxn x m2")
Precio_venta_vivienda = (f"Precio de venta de vivienda: ${precio_venta_vivienda:.2f}.mxn x m2")
# Costos Indirectos
porc_honorarios = 15.0   # Variable, dependiendo del costo por usuario
honorarios_profesionales = costos_directos * (porc_honorarios / 100.0)
print(f"Honorarios Profesionales ({porc_honorarios}%): ${honorarios_profesionales:.2f}.mxn")

Honorarios_Profesionales = (f"Honorarios Profesionales ({porc_honorarios}%): ${honorarios_profesionales:.2f}.mxn")

#Proceso Legal

porc_legales = 2.0    #Formula a editar, dependiendo del terreno
costos_legales = precio_venta_total * (porc_legales / 100.0)
print(f"Costos Legales ({porc_legales}%): ${costos_legales:.2f}")
Costos_Legales = (f"Costos Legales ({porc_legales}%): ${costos_legales:.2f}.mxn")

# Costos Aadministrativos 

porc_adm = 10.0
costos_administrativos = precio_venta_total * (porc_adm / 100.0)
print(f"Costos Administrativos ({porc_adm}%): ${costos_administrativos:.2f}")
Costos_Administrativos = (f"Costos Administrativos ({porc_adm}%): ${costos_administrativos:.2f}.mxn")

# Costos Financieros

porc_fin = 3.0
costos_financieros = precio_venta_total * (porc_fin / 100.0)
print(f"Costos Financieros ({porc_fin}%): ${costos_financieros:.2f}")
Costos_Financieros = (f"Costos Financieros ({porc_fin}%): ${costos_financieros:.2f}.mxn")

# Costos Comerciales 

porc_com = 6.0
costos_comerciales = precio_venta_total * (porc_com / 100.0)
print(f"Costos Comerciales ({porc_com}%): ${costos_comerciales:.2f}")
Costos_Comerciales = (f"Costos Comerciales ({porc_com}%): ${costos_comerciales:.2f}.mxn")

#---------------------

costos_indirectos = (
    honorarios_profesionales
    + costos_legales
    + costos_administrativos
    + costos_financieros
    + costos_comerciales
)
print(f"Costos Indirectos: ${costos_indirectos:.2f}")

Costos_Indirectos = (f"Costos Indirectos: ${costos_indirectos:.2f}.mxn") 


# ---------------------------------------------
#SECCIÓN “RENTABILIDAD CONSOLIDADA + SIMULACIÓN”
# ---------------------------------------------

# Costo total y rentabilidad


costo_total_construccion = valor_terreno + costos_directos + costos_indirectos + sum(_costo_estac_num)
Costo_total_Construccion_m2 = costo_total_construccion / cus_area 

print (f"Costo Total Construcción por m2 : ${Costo_total_Construccion_m2:.2f}")
print(f"Costo Total Construcción: ${costo_total_construccion:.2f}")
Costo_total_Construccion = (f"Costo Total de Construcción: ${costo_total_construccion:.2f}.mxn")
Costo_total_Construccion_m2 = (f"Costo Total de Construcción por m2: ${Costo_total_Construccion_m2:.2f}.mxn")



# 1) Suma el ingreso de locales (si aplica) antes de la simulación de uso de suelo mixto
# ------------------------------------------------------------------
ingreso_total  =  ( precio_venta_total + ingreso_local_tot if usos_mixtos else precio_venta_total ) 

# Recalcular indicadores con el ingreso combinado

ganancia_bruta0 = ingreso_total - costo_total_construccion 
ganancia_neta0  = ganancia_bruta0 * (IVA / 100.0)
utilidad0       = (ganancia_bruta0 / ingreso_total) * 100.0



# ---------------------------------------------
# Simulación para llegar a utilidad deseada
# ---------------------------------------------
def simulate_desired_utility(precio_venta_total, costo_total, utilidad_inicial,
                             utilidad_meta, incremento=1_000_000, max_iter=150_000):
    nuevo_precio     = precio_venta_total + ingreso_local_tot
    ganancia         = precio_venta_total - costo_total     # variable actual
    utilidad_actual  = utilidad_inicial
    iter_count       = 0

    while utilidad_actual < utilidad_meta and iter_count < max_iter:
        nuevo_precio    += incremento
        ganancia         = nuevo_precio - costo_total
        utilidad_actual  = (ganancia / nuevo_precio) * 100.0
        iter_count      += 1
        print(f"Iteración {iter_count}: utilidad = {utilidad_actual:.2f}%")

    return nuevo_precio, ganancia, utilidad_actual, iter_count

# Llamada a la simulación (usa ingreso_total)

if correrSimulacion:
    nuevo_precio, nueva_ganancia, utilidad_final, total_iter = simulate_desired_utility(
        ingreso_total,                 # Ahora incluye locales si aplica
        costo_total_construccion,
        utilidad0,
        utilidadDeseada
    )
else:
    # Si no se corre la simulación, usa los valores consolidados iniciales
    nuevo_precio     = ingreso_total 
    nueva_ganancia   = ganancia_bruta0
    utilidad_final   = utilidad0
    total_iter       = 0

print(f"\nNuevo Precio Venta Total: ${nuevo_precio:.2f}")
print(f"Nueva Ganancia Bruta:     ${nueva_ganancia:.2f}")
print(f"Utilidad Final:           {utilidad_final:.2f}%")
print(f"Total Iteraciones:        {total_iter}")

# Strings de salida
Nuevo_Precio_venta    = f"\nNuevo Precio Venta Total: ${nuevo_precio:.2f}"
Nueva_Ganancia_Bruta  = f"Nueva Ganancia Bruta: ${nueva_ganancia:.2f}"
Utilidad_Final        = f"Utilidad Final: {utilidad_final:.2f}%"
Total_Inter           = f"Total Iteraciones: {total_iter}"


# ===================== NUEVOS OUTPUTS SOLICITADOS =====================
Costo_de_Vivienda = ( area_venta / n_viviendas ) * precio_venta_total
Area_departamento = area_venta / n_viviendas 

# INORME DE EXCEL .......

import csv
import os

# ===================== EXPORTACIÓN A EXCEL =====================

if Reporte_excel:

    # Validar ruta
    if ruta_carpeta is None or ruta_carpeta.strip() == "":
        raise ValueError("Por favor conecta una ruta válida en el input 'ruta_carpeta' (ej. C:\\Users\\Sam\\Desktop)")

    carpeta_salida = ruta_carpeta.strip()
    nombre_archivo = "resultados_prefactibilidad.csv"
    ruta_archivo = os.path.join(carpeta_salida, nombre_archivo)

    #  Asegurarse de usar variables numéricas, no strings formateados
    Costo_de_Vivienda_valor = (area_venta / n_viviendas) * precio_venta_total
    Area_departamento_valor = area_venta / n_viviendas
    Costo_total_Construccion_m2_valor = costo_total_construccion / cus_area

        # >>> agregado: utilidades para listas
    def _join_list(lst):
        try:
            return " | ".join(str(x) for x in lst) if lst else "0"
        except Exception:
            return str(lst)

    resultados = {
        "Área Terreno (m2)": round(area_value, 2),
        "Valor del Terreno (MXN)": round(total_value, 2),
        "Área Neta (m2)": round(area_neta, 2),
        "Costo Demolición (MXN)": round(total_dem, 2),
        "Área COS (m2)": round(cos_area, 2),
        "Área CAS (m2)": round(cas_area, 2),
        "Área CUS (m2)": round(cus_area, 2),
        "Área Circulación (m2)": round(area_circulacion, 2),
        "Área Venta (m2)": round(area_venta, 2),  
        "Precio Venta Total (MXN/m2)": round(precio_venta_total, 2),
        "Precio Venta Vivienda (MXN/m2)": round(precio_venta_vivienda, 2),
        "Costo Vivienda (MXN)": round(Costo_de_Vivienda_valor, 2),
        "Área por Departamento (m2)": round(Area_departamento_valor, 2),
        "Área por Local (m2)": round(area_local, 2),                                               
        "Venta por Local (MXN)": round(venta_local, 2),                                              
        "Área Comercio (m2)": round(area_comercio, 2),  
        "Área por Local (m2)": round(area_local, 2),                                               
        "Venta por Local (MXN)": round(venta_local, 2),                                             
        "Área Comercio (m2)": round(area_comercio, 2),                                              
        "Estac. Cajones Vivienda (u)": _join_list(cajones_vivienda),                                
        "Estac. Cajones Comercio (u)": _join_list(cajones_comercio),                                
        "Estac. Cajones Totales (u)": _join_list(cajones_total),                                     
        "Estac. Área total (m2)": _join_list(area_m2),                                               
        "Estac. Costo total (MXN)": _join_list(costo_estac_total),  
        "Honorarios Profesionales (MXN)": round(honorarios_profesionales, 2),                        
        "Costos Legales (MXN)": round(costos_legales, 2),                                            
        "Costos Administrativos (MXN)": round(costos_administrativos, 2),                           
        "Costos Comerciales (MXN)": round(costos_comerciales, 2), 
        "Costos Directos (MXN)": round(costos_directos, 2),
        "Costos Indirectos (MXN)": round(costos_indirectos, 2),
        "Costo Total Construcción (MXN)": round(costo_total_construccion, 2),
        "Costo Total Construcción (MXN/m2)": round(Costo_total_Construccion_m2_valor, 2),
        "Utilidad Final (%)": round(utilidad_final, 2),
        "Nuevo Precio Venta Total (MXN)": round(nuevo_precio, 2),
        "Nueva Ganancia Bruta (MXN)": round(nueva_ganancia, 2),
        "Iteraciones Simulación": total_iter
    }

    try:
        with open(ruta_archivo, mode='w', newline='', encoding='utf-8') as archivo_csv:
            writer = csv.writer(archivo_csv)
            writer.writerow(["Variable", "Valor"])
            for clave, valor in resultados.items():
                writer.writerow([clave, valor])
        print(f"✅ Archivo exportado en: {ruta_archivo}")
        ruta_csv = ruta_archivo
        export_status = "✅ Exportado correctamente"
    except Exception as e:
        print(f"❌ Error al guardar el archivo CSV: {e}")
        ruta_csv = "Error"
        export_status = f"❌ Error: {e}"

else:
    print("🕒 'Reporte_excel' es False — no se exportó archivo.")
    ruta_csv = "Sin exportación"
    export_status = "🕒 Exportación desactivada"
# ---------- end prefactibilidad_economica_mty_2025 ----------

# ---- group: Comprobación Altura Máxima
addition = Addition(
    AlturaDeUsosMixtos=altura_de_de_usos_mixtos,
    AlturaDeEstacionamiento=altura_entrepisos_estacionamiento,
    AlturaDeVivienda=altura_entrepisos_vivienda)
númer_de_niveles_por_sumatoria = Panel(addition)
altura_máxima = Panel(prefactibilidad_economica_mty_2025.Num_Niveles)
subtraction = Subtraction(A=númer_de_niveles_por_sumatoria, B=altura_máxima)
resultado = Panel(subtraction)

# ----
área_vivienda = Panel(prefactibilidad_economica_mty_2025.Area_de_Venta)
área_comercio = Panel(prefactibilidad_economica_mty_2025.area_comercio)
número_de_niveles = Panel(prefactibilidad_economica_mty_2025.Num_Niveles)

# ---- group: Condicionantes
panel_4 = Panel("Toma de Decisiones")

# ---- group: Data a Colocar
panel_5 = Panel("Data a recolectar")

# ----
integer = Integer(prefactibilidad_economica_mty_2025.Costo_de_Vivienda)
no_interacciones = Panel(prefactibilidad_economica_mty_2025.Total_Inter)
estatus_de_exporteción_de_excel = Panel(prefactibilidad_economica_mty_2025.export_status)
número_de_niveles_2 = Panel(prefactibilidad_economica_mty_2025.Num_Niveles)
area_comercio = Panel(prefactibilidad_economica_mty_2025.area_comercio)
total_de_estacionamiento = Panel(prefactibilidad_economica_mty_2025.cajones_total)
utilidad_final = Panel(prefactibilidad_economica_mty_2025.costo_estac_total)
de_ganancia_bruta = Panel(prefactibilidad_economica_mty_2025.Nueva_Ganancia_Bruta)
costo_de_directos_totales = Panel(prefactibilidad_economica_mty_2025.Costos_Directos)
costos_indirectos = Panel(prefactibilidad_economica_mty_2025.Costos_Indirectos)
cajones_de_estacionamiento_vivienda = Panel(prefactibilidad_economica_mty_2025.cajones_vivienda)
cos_m2 = Panel(prefactibilidad_economica_mty_2025.COS_m2)
costo_de_venta = Panel(prefactibilidad_economica_mty_2025.Costo_de_Venta_total)
costo_de_venta_2 = Panel(prefactibilidad_economica_mty_2025.Precio_venta_vivienda)
honorarios_porfesionales = Panel(prefactibilidad_economica_mty_2025.Honorarios_Profesionales)
costos_legales = Panel(prefactibilidad_economica_mty_2025.Costos_Legales)
costos_financieros = Panel(prefactibilidad_economica_mty_2025.Costos_Financieros)
costo_total_por_m2_de_construccion = Panel(prefactibilidad_economica_mty_2025.Costo_total_Construccion_m2)
área_del_terreno = Panel(prefactibilidad_economica_mty_2025.Area_de_terreno)
valor_del_terreno_mxn = Panel(prefactibilidad_economica_mty_2025.Valor_del_terreno)
costo_de_venta_minima = Panel(prefactibilidad_economica_mty_2025.Costo_de_venta_minima)
cas_m2 = Panel(prefactibilidad_economica_mty_2025.CAS_m2)
costo_por_demilición = Panel(prefactibilidad_economica_mty_2025.Costo_de_demolicion)
cus_m2 = Panel(prefactibilidad_economica_mty_2025.CUS_m2)
utilidad_final_2 = Panel(prefactibilidad_economica_mty_2025.Utilidad_Final)
cajones_de_estacionamiento_uso_mixto = Panel(prefactibilidad_economica_mty_2025.cajones_comercio)
total_de_estacionamiento_2 = Panel(prefactibilidad_economica_mty_2025.area_m2)
área_estaionamiento = Panel(total_de_estacionamiento_2)
volumetria_prefactibilidad_economica_mty = Python3Script(
    crv_terreno=crv_terreno,
    COS=cos,
    CUS=cus,
    CAS=cas,
    altura_maxima=número_de_niveles,
    estacionamiento_tipo=estacionamiento,
    area_estacionamiento=área_estaionamiento,
    area_usos_mixtos=área_comercio,
    area_vivienda=área_vivienda,
    altura_usos_mixtos=altura_de_de_usos_mixtos,
    altura_estacionamiento=altura_entrepisos_estacionamiento,
    altura_entrepisos_vivienda=altura_entrepisos_vivienda)  # -> out, area_terreno, superficie_terreno, area_COS, area_CUS, area_CAS, centroide_terreno, superficie_COS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; "VOLUMETRIA PREFACTIBILIDAD ECONOMICA MTY 2025"; inputs crv_terreno: Curve, COS: Double, CUS: Double, CAS: Double, estacionamiento_tipo: String, area_estacionamiento: Double, area_usos_mixtos: Double, area_vivienda: Double, altura_usos_mixtos: Double, altura_entrepisos_vivienda: Double
# ---------- volumetria_prefactibilidad_economica_mty: Python ----------
import Rhino
from Rhino.Geometry import (
    AreaMassProperties,
    Brep,
    Extrusion,
    LoftType,
    Vector3d,
    Transform,
    Plane,
    Point3d
)
import math
import scriptcontext as sc

# ——— VALIDACIÓN DE ENTRADAS ———
if crv_terreno is None:
    raise ValueError("Conecta una curva válida al input 'crv_terreno'")

# ——— ÁREA DEL TERRENO  ———
props = AreaMassProperties.Compute(crv_terreno)
if props is None:
    raise ValueError("No se pudo calcular las propiedades de área de la curva")
area_terreno      = props.Area
centroide_terreno = props.Centroid

# ——— GENERACIÓN DE SUPERFICIE BASE ———
breps = Brep.CreatePlanarBreps(crv_terreno)
if not breps:
    raise ValueError("No se pudo generar la superficie a partir de la curva")
superficie_terreno = breps[0]

# ——— CÁLCULO DE ÁREAS POR NORMATIVA ———
area_COS = area_terreno * COS
area_CAS = area_terreno * CAS
area_CUS = area_terreno * CUS

# ——— OFFSET PARA SUPERFICIE COS ———
scale_factor = math.sqrt(area_COS / area_terreno)
ok, base_plane = crv_terreno.TryGetPlane(sc.doc.ModelAbsoluteTolerance)
if not ok:
    raise ValueError("La curva no es planar; no se puede determinar un plano de referencia")
centroid_plane = Plane(
    centroide_terreno,
    base_plane.XAxis,
    base_plane.YAxis
)
offset_curve = crv_terreno.DuplicateCurve()
xform = Transform.Scale(centroid_plane, scale_factor, scale_factor, scale_factor)
offset_curve.Transform(xform)
breps_offset = Brep.CreatePlanarBreps(offset_curve)
if not breps_offset:
    raise ValueError("No se pudo generar la superficie planar del offset")
superficie_COS = breps_offset[0]

# CÁLCULO DE SUPERFICIE CAS ———
tol = sc.doc.ModelAbsoluteTolerance
diff_breps = Brep.CreateBooleanDifference(superficie_COS, superficie_terreno, tol)
if not diff_breps:
    raise ValueError("No se pudo generar superficie_CAS por diferencia boolean")
superficie_CAS = diff_breps[0]

# -------------------------------------------------------------------------
# --- NUEVO: VOLUMETRÍA DE USOS MIXTOS CON SISTEMA DE LOSAS --------------
# -------------------------------------------------------------------------
volumetria_usos_mixtos = []   # lista de Breps por losa
losas_usos_mixtos = []        # curvas por losa
superficie_usos_mixtos = None

# Validar y convertir area_usos_mixtos a número
try:
    area_usos_mixtos_num = float(area_usos_mixtos) if area_usos_mixtos is not None else 0.0
except (ValueError, TypeError):
    area_usos_mixtos_num = 0.0

# Si area_usos_mixtos es None o 0 ⇒ no hay usos mixtos.
if area_usos_mixtos_num > 0:
    if altura_usos_mixtos is None:
        raise ValueError("Conecta un valor numérico al input 'altura_usos_mixtos'")
    
    # Calcular área de la losa base (usando offset_curve)
    props_cos_mixto = AreaMassProperties.Compute(offset_curve)
    if props_cos_mixto is None:
        raise ValueError("No se pudo calcular el área de la curva COS para usos mixtos")
    area_losa_mixto = props_cos_mixto.Area
    
    # Calcular número de losas completas y área restante
    n_losas_mixto = int(math.floor(area_usos_mixtos_num / area_losa_mixto))
    area_restante_mixto = area_usos_mixtos_num - (n_losas_mixto * area_losa_mixto)
    
    z_base_mixto = 0.0  # Los usos mixtos empiezan desde el nivel 0
    
    # Generar losas completas
    for i in range(n_losas_mixto):
        z = z_base_mixto + i * altura_usos_mixtos
        moved_crv = offset_curve.DuplicateCurve()
        moved_crv.Transform(Transform.Translation(0, 0, z))
        losas_usos_mixtos.append(moved_crv)
        
        extr = Rhino.Geometry.Extrusion.Create(moved_crv, altura_usos_mixtos, True)
        if extr:
            volumetria_usos_mixtos.append(extr.ToBrep())
    
    # Última losa ajustada (si hay área restante)
    if area_restante_mixto > 1e-3:
        factor_mixto = area_restante_mixto / area_losa_mixto
        scale_factor_mixto = math.sqrt(factor_mixto)
        
        last_curve_mixto = offset_curve.DuplicateCurve()
        # Escalar desde el centroide para mantener dentro del perímetro
        centroid_point = Point3d(centroide_terreno.X, centroide_terreno.Y, 0)
        xform_scale = Transform.Scale(centroid_point, scale_factor_mixto)
        last_curve_mixto.Transform(xform_scale)
        
        last_z_mixto = z_base_mixto + n_losas_mixto * altura_usos_mixtos
        last_curve_mixto.Transform(Transform.Translation(0, 0, last_z_mixto))
        losas_usos_mixtos.append(last_curve_mixto)
        
        extr = Rhino.Geometry.Extrusion.Create(last_curve_mixto, altura_usos_mixtos, True)
        if extr:
            volumetria_usos_mixtos.append(extr.ToBrep())
    
    # Crear superficie_usos_mixtos como el primer Brep para compatibilidad
    if volumetria_usos_mixtos:
        superficie_usos_mixtos = volumetria_usos_mixtos[0]

# -------------------------------------------------------------------------
# --- CONTROL DE EJECUCIÓN DEL BLOQUE DE ESTACIONAMIENTO (SIN CAMBIOS) ---
# -------------------------------------------------------------------------
volumetria_estacionamiento = []   # lista de Breps por losa
losas_estacionamiento      = []   # curvas por losa
altura_total_est_niveles   = 0.0

# Si area_estacionamiento es None ⇒ no hay estacionamiento.
if area_estacionamiento is not None:
    if area_estacionamiento < 0:
        raise ValueError("area_estacionamiento no puede ser negativo")

    if area_estacionamiento > 0:
        if altura_estacionamiento is None:
            raise ValueError("Conecta un valor numérico al input 'altura_estacionamiento'")

        # ---------- BLOQUE ORIGINAL DE ESTACIONAMIENTO (sin cambios) ----------
        props_cos_est = AreaMassProperties.Compute(offset_curve)
        if props_cos_est is None:
            raise ValueError("No se pudo calcular el área de la curva COS para estacionamiento")
        area_losa_est = props_cos_est.Area

        edges = [e.DuplicateCurve() for e in superficie_COS.Edges]
        edge_lengths = [e.GetLength() for e in edges]
        min_idx = edge_lengths.index(min(edge_lengths))
        base_edge = edges[min_idx]
        base_length = edge_lengths[min_idx]
        if base_length <= 0:
            raise ValueError("El lado más corto del COS tiene longitud no válida.")

        pt0 = base_edge.PointAtStart
        tangent = base_edge.TangentAtStart
        tangent.Unitize()

        perp_vector = Rhino.Geometry.Vector3d.CrossProduct(base_plane.ZAxis, tangent)
        perp_vector.Unitize()

        test_pt = pt0 + perp_vector * 0.5
        if not superficie_COS.IsPointInside(test_pt, sc.doc.ModelAbsoluteTolerance, True):
            perp_vector.Reverse()

        anchor_plane = Plane(pt0, tangent, perp_vector)

        n_losas_est = int(math.floor(area_estacionamiento / area_losa_est))
        area_restante_est = area_estacionamiento - (n_losas_est * area_losa_est)

        if estacionamiento_tipo == "Estacionamiento Subterraneo":
            step_est   = -abs(altura_estacionamiento)
            base_z_est = 0.0
        elif estacionamiento_tipo == "Estacionamiento en Niveles":
            step_est   =  abs(altura_estacionamiento)
            # Si hay usos mixtos, empieza después de ellos. Si no, empieza desde 0
            base_z_est = altura_usos_mixtos if area_usos_mixtos_num > 0 else 0.0
        else:
            raise ValueError("Elige 'Estacionamiento Subterraneo' o 'Estacionamiento en Niveles'")

        # Losas completas
        for i in range(n_losas_est):
            z = base_z_est + i * step_est
            moved_crv = offset_curve.DuplicateCurve()
            moved_crv.Transform(Transform.Translation(0, 0, z))
            losas_estacionamiento.append(moved_crv)

            extr = Rhino.Geometry.Extrusion.Create(moved_crv, step_est, True)
            if extr:
                volumetria_estacionamiento.append(extr.ToBrep())

        # Última losa ajustada
        if area_restante_est > 1e-3:
            factor_est = area_restante_est / area_losa_est
            factor_est = max(factor_est, 1e-6)
            
            scale_factor_est = math.sqrt(factor_est)
            
            last_curve = offset_curve.DuplicateCurve()
            centroid_point = Point3d(centroide_terreno.X, centroide_terreno.Y, 0)
            xform_scale = Transform.Scale(centroid_point, scale_factor_est)
            last_curve.Transform(xform_scale)

            last_z = base_z_est + n_losas_est * step_est
            last_curve.Transform(Transform.Translation(0, 0, last_z))
            losas_estacionamiento.append(last_curve)

            extr = Rhino.Geometry.Extrusion.Create(last_curve, step_est, True)
            if extr:
                volumetria_estacionamiento.append(extr.ToBrep())

        # Altura total para vivienda en niveles
        if estacionamiento_tipo == "Estacionamiento en Niveles":
            niveles_generados = n_losas_est + (1 if area_restante_est > 1e-3 else 0)
            altura_total_est_niveles = niveles_generados * abs(altura_estacionamiento)

# -------------------------------------------------------------------------
# --- VOLUMETRÍA DE VIVIENDA MODIFICADA PARA USAR area_vivienda ----------
# -------------------------------------------------------------------------
volumetria_vivienda = []
losas_vivienda = []

# Calcular z_inicial considerando si hay usos mixtos y estacionamiento
z_inicial = 0.0

# Primero agregar altura de usos mixtos si existe
if area_usos_mixtos_num > 0:
    # Calcular altura total de usos mixtos basada en las losas generadas
    altura_total_mixtos = len(losas_usos_mixtos) * altura_usos_mixtos
    z_inicial += altura_total_mixtos

# Luego considerar el tipo de estacionamiento
if estacionamiento_tipo == "Estacionamiento Subterraneo":
    # El estacionamiento subterráneo no afecta la altura inicial de vivienda
    pass
elif estacionamiento_tipo == "Estacionamiento en Niveles":
    # Solo agregar altura de estacionamiento si realmente se generó estacionamiento
    if area_estacionamiento is not None and area_estacionamiento > 0:
        z_inicial += altura_total_est_niveles
else:
    raise ValueError("Tipo de estacionamiento no reconocido para volumetría de vivienda.")

if altura_entrepisos_vivienda is None:
    raise ValueError("Conecta un valor numérico al input 'altura_entrepisos_vivienda'")

# Validar area_vivienda
if area_vivienda is None:
    raise ValueError("Conecta un valor numérico al input 'area_vivienda'")

try:
    area_vivienda_num = float(area_vivienda)
except (ValueError, TypeError):
    raise ValueError("area_vivienda debe ser un valor numérico válido")

if area_vivienda_num <= 0:
    raise ValueError("area_vivienda debe ser mayor que 0")

# Usar area_vivienda en lugar de area_CUS
props_cos = AreaMassProperties.Compute(offset_curve)
if props_cos is None:
    raise ValueError("No se pudo calcular el área de la curva COS")
area_losa = props_cos.Area

num_losas_completas = int(math.floor(area_vivienda_num / area_losa))
area_restante = area_vivienda_num - (area_losa * num_losas_completas)

# Losas completas vivienda
for i in range(num_losas_completas):
    z = z_inicial + i * altura_entrepisos_vivienda
    moved_crv = offset_curve.DuplicateCurve()
    moved_crv.Transform(Transform.Translation(0, 0, z))
    losas_vivienda.append(moved_crv)
    extr = Rhino.Geometry.Extrusion.Create(moved_crv, altura_entrepisos_vivienda, True)
    if extr:
        volumetria_vivienda.append(extr.ToBrep())

# Última losa vivienda
if area_restante > 1e-3:
    scale_factor = math.sqrt(area_restante / area_losa)
    last_z = z_inicial + num_losas_completas * altura_entrepisos_vivienda
    anchor_pt = Point3d(centroide_terreno.X, centroide_terreno.Y, 0)
    last_curve = offset_curve.DuplicateCurve()
    xform_scale = Transform.Scale(anchor_pt, scale_factor)
    last_curve.Transform(xform_scale)
    last_curve.Transform(Transform.Translation(0, 0, last_z))
    losas_vivienda.append(last_curve)
    extr = Rhino.Geometry.Extrusion.Create(last_curve, altura_entrepisos_vivienda, True)
    if extr:
        volumetria_vivienda.append(extr.ToBrep())

# ——— CONTROL DE ALTURA MÁXIMA ———
if altura_maxima is None:
    raise ValueError("Conecta un valor numérico al input 'altura_maxima'")

try:
    altura_maxima_num = float(altura_maxima)
except (ValueError, TypeError):
    raise ValueError("altura_maxima debe ser un valor numérico válido")

if altura_maxima_num <= 0:
    raise ValueError("altura_maxima debe ser mayor que 0")

# Calcular altura total del proyecto
altura_total_proyecto = 0.0

# 1. Altura de Usos Mixtos
if area_usos_mixtos_num > 0 and losas_usos_mixtos:
    altura_usos_mixtos_total = len(losas_usos_mixtos) * altura_usos_mixtos
    altura_total_proyecto += altura_usos_mixtos_total

# 2. Altura de Estacionamiento en Niveles (subterráneo no cuenta para altura máxima)
if (area_estacionamiento is not None and area_estacionamiento > 0 and 
    estacionamiento_tipo == "Estacionamiento en Niveles"):
    altura_total_proyecto += altura_total_est_niveles

# 3. Altura de Vivienda
if losas_vivienda:
    altura_vivienda_total = len(losas_vivienda) * altura_entrepisos_vivienda
    altura_total_proyecto += altura_vivienda_total

# Generar mensaje de estatus
if altura_total_proyecto <= altura_maxima_num:
    altura_estatus = "✅ El proyecto cumple con Altura Máxima"
else:
    altura_estatus = "⚠️ CUIDADO el proyecto NO cumple con Altura Máxima"

# ——— Salidas ———
# area_terreno
# superficie_terreno
# centroide_terreno
# area_COS, area_CAS, area_CUS
# superficie_COS, superficie_CAS, superficie_usos_mixtos
# volumetria_usos_mixtos          (NUEVO: lista de Breps por losa)
# losas_usos_mixtos               (NUEVO: curvas base por losa)
# volumetria_estacionamiento      (lista de Breps por losa)
# losas_estacionamiento           (curvas base por losa)
# volumetria_vivienda
# losas_vivienda
# altura_total_proyecto           (NUEVO: altura total calculada)
# altura_estatus                  (NUEVO: mensaje de cumplimiento)
# ---------- end volumetria_prefactibilidad_economica_mty ----------
área_de_terreno = Panel(volumetria_prefactibilidad_economica_mty.area_terreno)
área_cos = Panel(volumetria_prefactibilidad_economica_mty.area_COS)
point = Point(volumetria_prefactibilidad_economica_mty.centroide_terreno)
curve_2 = Curve(volumetria_prefactibilidad_economica_mty.losas_usos_mixtos)
curve_3 = Curve(volumetria_prefactibilidad_economica_mty.losas_vivienda)
curve_4 = Curve(volumetria_prefactibilidad_economica_mty.losas_estacionamiento)
surface_cos = Surface(volumetria_prefactibilidad_economica_mty.superficie_COS)
brep_usos_mixtos = Brep(volumetria_prefactibilidad_economica_mty.volumetria_usos_mixtos)

# ---- group: comprobación usos mixtos
selección_de_superficie = Slider(4, range=0..6)
deconstruct_brep = DeconstructBrep(BrepUSOSMIXTOS=brep_usos_mixtos)  # -> Faces, Edges, Vertices
list_item = ListItem(List=deconstruct_brep.Faces, Index=selección_de_superficie, Wrap=True)
superficie_usos_mixtos = Surface(list_item)
area = Area(Geometry=superficie_usos_mixtos)  # -> Area, Centroid
panel_6 = Panel(area.Area)
área_comercio_2 = Panel(prefactibilidad_economica_mty_2025.area_comercio)
subtraction_2 = Subtraction(A=panel_6, B=área_comercio_2)
panel_7 = Panel(subtraction_2)

# ---- group: Colo Usos MIXTOS
colour_rgb = ColourRGB(Alpha=255, Red="150", Green="103", Blue="99")
custom_preview = CustomPreview(Geometry=brep_usos_mixtos, Material=colour_rgb)

# ----
estatus_de_altura_del_proyecto = Panel(volumetria_prefactibilidad_economica_mty.altura_estatus)
lote = Surface(volumetria_prefactibilidad_economica_mty.superficie_terreno)
área_cus = Panel(volumetria_prefactibilidad_economica_mty.area_CUS)
brep_estacionamiento_subterraneo = Brep(volumetria_prefactibilidad_economica_mty.volumetria_estacionamiento)

# ---- group: Comprobacion estacionmiento
deconstruct_brep_2 = DeconstructBrep(BrepESTACIONAMIENTO=brep_estacionamiento_subterraneo)  # -> Faces, Edges, Vertices
sulección_de_superficie = Slider(2, range=0..10)
selección_de_superficie_2 = Slider(4, range=0..6)
list_item_2 = ListItem(List=deconstruct_brep_2.Faces, Index=selección_de_superficie_2, Wrap=True)
point_list = PointList(Points=deconstruct_brep_2.Vertices, Size=sulección_de_superficie)
superficie_estacionamiento = Surface(list_item_2)
area_2 = Area(Geometry=superficie_estacionamiento)  # -> Area, Centroid
panel_8 = Panel(area_2.Area)
área_estaionamiento_2 = Panel(total_de_estacionamiento_2)
subtraction_3 = Subtraction(A=panel_8, B=área_estaionamiento_2)
panel_9 = Panel(subtraction_3)

# ---- group: Estacionamiento
colour_rgb_2 = ColourRGB(Alpha=255, Red="150", Green="154", Blue="158")
custom_preview_2 = CustomPreview(Geometry=brep_estacionamiento_subterraneo, Material=colour_rgb_2)

# ----
surface_cas = Surface(volumetria_prefactibilidad_economica_mty.superficie_CAS)

# ---- group: Superficies de CAS
colour_rgb_3 = ColourRGB(Alpha=255, Red="179", Green="178", Blue="143")
custom_preview_3 = CustomPreview(Geometry=surface_cas, Material=colour_rgb_3)

# ----
brep_vivienda = Brep(volumetria_prefactibilidad_economica_mty.volumetria_vivienda)

# ---- group: Comprobacion vivienda
deconstruct_brep_3 = DeconstructBrep(BrepVIVIENDA=brep_vivienda)  # -> flatten(Faces), Edges, Vertices
list_item_3 = ListItem(List=deconstruct_brep_3.Faces, Index=Slider(4, range=0..6), Wrap=True)
list_item_4 = ListItem(List=deconstruct_brep_3.Faces, Index=Slider(10, range=0..12), Wrap=True)
superficie_de_vivienda = Surface(list_item_4)
superficie_vivienda = Surface(list_item_3)
area_3 = Area(Geometry=superficie_vivienda)  # -> Area, Centroid
area_4 = Area(Geometry=superficie_de_vivienda)  # -> Area, Centroid
panel_10 = Panel(area_3.Area)
panel_11 = Panel(area_4.Area)
addition_2 = Addition(A=panel_10, B=panel_11)
panel_12 = Panel(addition_2)
área_vivienda_2 = Panel(prefactibilidad_economica_mty_2025.Area_de_Venta)
subtraction_4 = Subtraction(A=panel_12, B=área_vivienda_2)
panel_13 = Panel(subtraction_4)

# ---- group: Color Vivienda
colour_rgb_4 = ColourRGB(Alpha=255, Red="192", Green="196", Blue="188")
custom_preview_4 = CustomPreview(Geometry=brep_vivienda, Material=colour_rgb_4)

# ----
área_cas = Panel(volumetria_prefactibilidad_economica_mty.area_CAS)
ingreso_total_de_locales = Panel(prefactibilidad_economica_mty_2025.Ingreso_de_locales)
precio_de_venta = Panel(prefactibilidad_economica_mty_2025.Nuevo_Precio_venta)
ruta_donde_se_guardo_el_documento = Panel(prefactibilidad_economica_mty_2025.ruta_csv)
costo_de_venta_por_departameto = Panel(integer)
area_del_departamento = Panel(prefactibilidad_economica_mty_2025.Area_departamento)
costos_administrativos = Panel(prefactibilidad_economica_mty_2025.Costos_Administrativos)
costos_comerciales = Panel(prefactibilidad_economica_mty_2025.Costos_Comerciales)
costo_final_de_construccion = Panel(prefactibilidad_economica_mty_2025.Costo_total_Construccion)
area_neta = Panel(prefactibilidad_economica_mty_2025.area_neta)
costo_por_m2_de_construccion = Panel(prefactibilidad_economica_mty_2025.Costo_por_m2_construccion)
area_de_venta_total = Panel(prefactibilidad_economica_mty_2025.Area_de_Venta)
venta_de_cada_local = Panel(prefactibilidad_economica_mty_2025.Venta_de_local)
area_de_locale_c_u = Panel(prefactibilidad_economica_mty_2025.Area_de_local)
información_generada = Panel(prefactibilidad_economica_mty_2025.out)

addition_3 = Addition(ÁreaEstacionamiento=área_estaionamiento, ÁreaUsosMixtos=área_comercio)
addition_4 = Addition(ResultadoEstacionamientoUsosMixtos=addition_3, AreaDeVivienda=área_vivienda)
panel_14 = Panel(addition_3)
subtraction_5 = Subtraction(AreaMaximaDeConstrucción=área_cus, ResultadoEstacionamientoUsosMixtos=panel_14)
panel_15 = Panel(addition_4)
subtraction_6 = Subtraction(ÁreaMaximaDeConstrucción=área_cus, ResultadoDeSumatoriaDeÁreas=panel_15)

# ---- group: Area de Venta
panel_16 = Panel(subtraction_5)

# ---- group: Resultado de que estamos usando el maximo de Area Construible
panel_17 = Panel(subtraction_6)

# ----
division = Division(AreaDeVenta=panel_16, NúmeroDeDepartamentos=no_de_viviendas)

# ---- group: m2 por depa
panel_18 = Panel(division)

# ==== cluster DefiniciónTipoDeEstacionamiento: Este Script tpermiteelegir si el estacionamiento es Por Niveles o Subterraneo
tipo_de_estacionamiento = ClusterInput()

# ---- group: Tipo de Estacionamiento
panel = Panel("Estacionamiento Subterraneo")
panel_2 = Panel("Estacionamiento en Niveles")

# ----
tipo_de_estacionamiento_2 = Integer(tipo_de_estacionamiento)
merge = Merge(Data1=panel, Data2=panel_2)
item = ListItem(List=merge, Index=tipo_de_estacionamiento_2, Wrap=True)
tipo_de_estacionamiento_3 = Text(item)
tipo_de_estacionamiento_4 = ClusterOutput(tipo_de_estacionamiento_3)

# ==== cluster CostoPorM2DeConstruccion: En este Cluster encontraras el costo por m2 de construccion de Nuevo Leon, en el 2025
tipo_de_vivienda = ClusterInput()
porcentaje_de_indirectos = Panel(".28")
tipo_de_vivienda_2 = Integer(tipo_de_vivienda)
multiplication = Multiplication(A=tipo_de_vivienda, B=porcentaje_de_indirectos)
_28_de_indirectos = Addition(TipoDeVivienda=tipo_de_vivienda_2, B=multiplication)
costo_por_m2_de_construcción = Panel(_28_de_indirectos)
costo_por_m2_de_construccion = Integer(costo_por_m2_de_construcción)
costo_por_m2_de_construccion_2 = ClusterOutput(costo_por_m2_de_construccion)

# ==== cluster COEFICIENTESCOSCUSCAS: Este script tepermitira elegir la normativa correspondiente al distrito de tu terreno conforme al plan de desarrollo urbano de monterrey 2024
normativa = ClusterInput()
normativa_2 = Text(normativa)
split = TextSplit(Text=normativa_2, Separators="\"")
item = ListItem(List=split, Index="0", Wrap=True)
panel = Panel(split)
item_2 = ListItem(List=split, Index="1", Wrap=True)
item_3 = ListItem(List=split, Index="2", Wrap=True)
panel_2 = Panel(item_3)
panel_3 = Panel(item_2)
panel_4 = Panel(item)
cos = Number(panel_4)
cus = Number(panel_2)
cas = Number(panel_3)
cus_2 = ClusterOutput(cus)

# ---- group: Cluster Output
cos_2 = ClusterOutput(cos)

# ----
cas_2 = ClusterOutput(cas)

# ==== cluster InformaciónDeTerreno
parametro_retiros = ClusterInput()
curva_de_terreno = ClusterInput()
retiro_via = ClusterInput()
curva_de_terreno_2 = Curve(curva_de_terreno)
parametro_retiros_2 = Number(parametro_retiros)
retiro_via_2 = Number(retiro_via)
join_curves = JoinCurves(Curves=curva_de_terreno_2, Preserve=False)
crvlote = Curve(join_curves)
cluster = Cluster(crvlote=crvlote, paramento=parametro_retiros_2, retirovia=retiro_via_2)
boundary_surfaces = BoundarySurfaces(Edges=join_curves)
crvretiros = Curve(cluster)
area = Area(Geometry=boundary_surfaces)  # -> Area, Centroid
area_2 = Area(Geometry=crvretiros)  # -> Area, Centroid
panel = Panel(area.Area)
panel_2 = Panel(area_2.Area)
subtraction = Subtraction(A=panel, B=panel_2)
panel_3 = Panel(subtraction)
terreno = Surface(boundary_surfaces)
curva_de_retiros = Curve(crvretiros)
area_de_retiro = Number(panel_3)
terreno_2 = ClusterOutput(terreno)
curva_de_retiros_2 = ClusterOutput(curva_de_retiros)
area_de_retiro_2 = ClusterOutput(area_de_retiro)

# ==== cluster Cluster
crvlote = ClusterInput()
paramento = ClusterInput()
retirovia = ClusterInput()
crvlote_2 = Curve(crvlote)
paramento_2 = Integer(paramento)
retirovia_2 = Number(retirovia)
number_slider = Slider(10, range=0..10)
explode = Explode(Curve=crvlote_2, Recursive=True)  # -> Segments, Vertices
item = ListItem(List=explode.Segments, Index=paramento_2, Wrap=True)
neg = Negative(Value=retirovia_2)
boundary = BoundarySurfaces(Edges=crvlote_2)
ext = ExtendCurve(Curve=item, Type=0, Start=number_slider, End=number_slider)
offset = OffsetCurve(Curve=ext, Distance=neg, Corners=1)
srfsplit = SurfaceSplit(Surface=boundary, Curves=offset)
item_2 = ListItem(List=srfsplit, Index=0, Wrap=True)
edges = BrepEdges(Brep=item_2)  # -> Naked, Interior, NonManifold
join = JoinCurves(Curves=edges.Naked, Preserve=False)
crvlote_retiros = Curve(join)
crvlote_retiros_2 = ClusterOutput(crvlote_retiros)
